vi "index.gviweb"   [LabVIEW NXG 5.0.0]
panel controls:
  "Text to scroll": string
  "send": bool
  "Color": "Color.gtype" = 4278190080
  "Stop": bool
  "clear": bool
  "on": bool
panel indicators:
  "Connected?": bool
  "WebSockets URL": string
types:
  "Color.gtype" = u32
uses:
  WebApp::GetHostname.jsli::GetHostname
  NI::WebSockets::Close WebSocket.gvi
  NI::G Core::Error::Clear Error Cluster.gvi
  NI::WebSockets::Open WebSocket.gvi
  NI::WebSockets::Write String.gvi
  NI::WebSockets::Read String.gvi
diagram:
  call "GetHostname"() -> (return=w1, error out=w2)
  Format Into String(formatString="ws://%s:6123", errIn=w2, w1) -> (outString=w3, errOut=w4)
  $"WebSockets URL" <- w3
  # Place setup code before the loop. For example, perform initial data communication and wire the results into the loop.
  # Change this according to whether it's being hosted on the Pi (e.g. localhost) or you are accessing remotely (Pi IP address)
  # Top-Level WebVIs usually contain a While Loop that never stops so that they can continue running as long as the web page is open in the user's web browser.
  s1 = "Initialize"  # shift register
  s2 = uninitialised  # shift register
  while {
    case (s1) {
      frame "Initialize", Default {
        w5 = "Connecting"
        w6 = w4
        w7 = s2
        w8 = default
      }
      frame "Connecting" {
        call "Close WebSocket.gvi"(websocket session in=s2, error in=w4) -> (error out=w9)
        call "Clear Error Cluster.gvi"(error in=w9) -> (error out=w10)
        call "Open WebSocket.gvi"(url=w3, error in=w10) -> (websocket session out=w7, error out=w6)
        Select(s=w6, t="Connecting", f="Idle") -> w5
        Not(x=w6) -> w11
        $"Connected?" <- w11
        Wait(time to wait=250)
        w8 = default
      }
      frame "Idle" {
        event {
          on "clear" Value changed; "on" Value changed; "send" Value changed {
            w5 = "Write"
          }
          on "Stop" Value changed {
            w12 = "Deconnecting"  # Satates
            w5 = w12
          }
        }
        w6 = w4
        w7 = s2
        w8 = default
      }
      frame "Write" {
        To Signed 32 Bit Integer(number=$Color) -> w13
        Format Into String(formatString="%1$s::%2$f", $"Text to scroll", w13) -> w14
        Select(s=$on, t="on", f="") -> w15
        Select(s=$clear, t="clear", f=w15) -> w16
        Select(s=$send, t=w14, f=w16) -> w17
        call "Write String.gvi"(websocket session in=s2, string message=w17, error in=w4) -> (websocket session out=w7, error out=w6)
        Select(s=w6, t="Connecting", f="Read") -> w5
        w8 = default
      }
      frame "Read" {
        call "Read String.gvi"(websocket session in=s2, timeout=1, error in=w4) -> (websocket session out=w7, string response=w18, error out=w6)
        To Upper Case(string=w18) -> w19
        Is Equal(x="TRUE", y=w19) -> w20
        Select(s=w20, t="Idle", f="Read") -> w21
        Select(s=w6, t="Connecting", f=w21) -> w5
        w8 = default
      }
      frame "Deconnecting" {
        Two Button Dialog(message="Do you want to quitt?") -> (T Button?=w22)
        case (w22) {
          frame False, Default {
            w23 = "Idle"  # Satates
            w6 = w4
            w7 = s2
            w5 = w23
          }
          frame True {
            w24 = "Exit"  # Satates
            call "Close WebSocket.gvi"(websocket session in=s2, error in=w4) -> (error out=w6)
            w7 = default
            w5 = w24
          }
        }
        w8 = default
      }
      frame "Exit" {
        w25 = "Exit"  # Satates
        w5 = w25
        w6 = w4
        w7 = s2
        w8 = TRUE
      }
      frame "Clear" {
        w26 = "Idle"  # Satates
        call "Write String.gvi"(websocket session in=s2, string message="CLEAR", error in=w4) -> (websocket session out=w7, error out=w6)
        w5 = w26
        w8 = default
      }
      frame "On" {
        w27 = "Idle"  # Satates
        call "Write String.gvi"(websocket session in=s2, string message="ON", error in=w4) -> (websocket session out=w7, error out=w6)
        w5 = w27
        w8 = default
      }
    }
    next s1 = w5
    next s2 = w7
    stop if w8
  }
